# Grasshopper definition Geometric Design with Sine Wave.gh (Grasshopper 1.0.7)

# ----
# 3. Creating new axis/points
# for our sine wave to branch from
# I chose a circle because it will allow
# me to divide the axis in a 360 degree
# rotation, the division will be determined
#  by the count slider
count = Slider(15, range=0..50)
cir = Circle(Plane=PlaneXY(0, 0, 0), Radius=1)
divide = DivideCurve(Curve=cir, Count=count, Kinks=False)  # -> Points, Tangents, Parameters

# ----
# 1. Adjustable Parameters for
# Sine Wave Function
length = Slider(100, range=0..100)
phase = Slider(0, range=0..50)
cycle = Slider(1, range=0..5)
# 10.014 Computational Design Thinking
# Assignment 1 by Darren Chan Yu Hao 1006340
length_2 = Slider(7, range=0..50)

# ----
# 2. Sine Wave Function
series = Series(Start=0, Step=1, Count=length_2)
expression = Expression(i=series, n=length_2, Expression="i/(n-1)")
expression_2 = Expression(r=length, c=cycle, t=expression, p=phase, Expression="r * sin(2 * π * c * t + p)")
pt = ConstructPoint(XCoordinate=0, YCoordinate=expression_2, ZCoordinate=series)
intcrv = Interpolate(Vertices=pt, Degree=3, Periodic=False, KnotStyle=1)  # -> Curve, Length, Domain

# ----
# 4. First Translation:
# Making the sine curve
# appear on every point
# on the circle in the z-direction
move = Move(Geometry=intcrv.Curve, Motion=divide.Points)  # -> Geometry, Transform
crv = Curve(move.Geometry)

# ----
# 5. Creation of planes along z-axis
# This is done so that the sine
# curve will curve outwards when
# viewed from the Top perspective.
# It will fan out in the y and x axis
count_2 = Slider(8, range=0..50)
steps = Slider(3, range=0..50)
count_3 = Slider(1, range=0..50)
series_2 = Series(Start=0, Step=steps, Count=count_2)
divide_2 = DivideCurve(Curve=crv, Count=count_3, Kinks=False)  # -> Points, Tangents, Parameters
Z = UnitZ(Factor=series_2)
pt_2 = Point(Point(0, 0, 0))
vec2pt = Vector2Pt(PointA=pt_2, PointB=divide_2.Points, Unitize=False)  # -> Vector, Length
xprod = CrossProduct(VectorA=vec2pt.Vector, VectorB=Z, Unitize=False)  # -> Vector, Length
pl = ConstructPlane(Origin=Point(0, 0, 0), XAxis=vec2pt.Vector, YAxis=xprod.Vector)

# ----
# 6. Final Results! (Without Color)
# For normal viewing, this should be
# the only component that should be
# previewed, however!
# 
# Of course, different results will appear
#  if you preview the previous translation
#  iteration with this together!
orient = Orient(Geometry=move.Geometry, Source=PlaneXY(0, 0, 0), Target=pl)  # -> Geometry, Transform

# ----
# 7. Final Results! (Colored)
green = Slider(127, range=0..256)
red = Slider(256, range=0..256)
blue = Slider(189, range=0..256)
rgb = ColourRGB(Alpha=255, Red=red, Green=green, Blue=blue)
preview = CustomPreview(Geometry=orient.Geometry, Material=rgb)
