# Grasshopper definition Surface Design with Sine and Cosine Waves.gh (Grasshopper 1.0.7)

nx = Slider(20, range=2..100)
ny = Slider(20, range=2..100)

# ----
# PAGE 4
# Surface Creation
series = Series(Start=0, Step=1, Count=nx)
series_2 = Series(Start=0, Step=1, Count=ny)
# Additive Manufacturing
construct_point = ConstructPoint(XCoordinate=series, YCoordinate=graft(series_2), ZCoordinate=0)
height = Slider(3, range=1..10)
change = Slider(3, range=1..10)
sy = Slider(8, range=0..100)
sx = Slider(100, range=0..100)
# Extract quantitative data relating to printing constraints
# Total size < 95 mm
phase = Slider(10, range=0..10)
deconstruct = Deconstruct(Point=construct_point)  # -> XComponent, YComponent, ZComponent
series_3 = Series(Start=0, Step=1, Count=height)
python = GhPythonScript(
    x=deconstruct.XComponent,
    y=deconstruct.YComponent,
    xLength=nx,
    yLength=ny,
    sy=sy,
    sx=sx,
    Height=series_3,
    Change=change,
    Phase=phase)  # -> z
# ---------- python: Python ----------
__author__ = "littl"
__version__ = "2021.10.08"

from math import *
import rhinoscriptsyntax as rs

""" ===============================================================================================
<Idea Description>
The idea of this surface is to create an outside ring with a more gentle surface while the inside
showcase a spike, the spikes representing the stressful and unpleasant situation we are all in
=============================================================================================== """

"""===============================================================================================
<Code Idea>

The if else in this python script is used to split the surface into 4 sqaure rings
The if else starts with the inner most ring, to outer most ring

Variable Explaination:
    sy and sx are scale for our y and x
    Height is used to vary the amplitude of the wave
    Change is used to vary inner curve modulus
    x and y are the inputs for number of cycles to compute Z
    xLength and yLength are the dimensions of the surface
    Phase is used to vary the inner rings surface
=============================================================================================== """

""" ===============================================================================================
The inner most ring to the 3rd inner ring are all using the same eqn but with varied max height to
for the impression of a gradual increase in height till you reach he center where you will be on top
of the world :)

The basis of the if else uses xLength and yLength of the shape for scalability purposes
The nested if is to ensure that the base is flat
=============================================================================================== """

if((x >= xLength * 1.7/4 and x < xLength * 2.2/4) and (y >= yLength * 1.7/4 and y < yLength * 2.2/4)) :
    z = 1.6*Height * sin(x%Change * y%Change + Phase * sin(x * y)) * Height/(exp(sy/sx+0.01))
    if (z < 0):
        z = 0

elif((x >= xLength * 1.2/4 and x < xLength * 2.5/4) and (y >= yLength * 1.2/4 and y < yLength * 2.5/4)) :
    z = 1.25*Height * sin(x%Change * y%Change + Phase * sin(x * y)) * Height/(exp(sy/sx+0.01))
    if (z < 0):
        z = 0

elif((x >= xLength * 1/4 and x < xLength * 3/4) and (y >= yLength * 1/4 and y < yLength * 3/4)) :
    z = 0.7*Height * sin(x%Change * y%Change + Phase* sin(x * y)) * Height/(exp(sy/sx+0.01))
    if (z < 0):
        z = 0

else : 
    z = Height * sin(y) * sin(x) * sin(Change)
""" ===============================================================================================
The final else, is for the most outer ring, which constructs a simple gentle rolling hills type of curve
to give the impression of calmness and peace
=============================================================================================== """
# ---------- end python ----------
construct_point_2 = ConstructPoint(XCoordinate=deconstruct.XComponent, YCoordinate=deconstruct.YComponent, ZCoordinate=python)
surface_from_points = SurfaceFromPoints(Points=flatten(construct_point_2), UCount=ny, Interpolate=True)

scale = Slider(5, range=0..10)
scale_2 = Scale(Geometry=surface_from_points, Center=Point(0, 0, 0), Factor=scale)  # -> Geometry, Transform

# ----
# Input Open Srf Here
deconstruct_brep = DeconstructBrep(Brep=scale_2.Geometry)  # -> Faces, Edges, Vertices
bounding_box = BoundingBox(Content=scale_2.Geometry, Plane=PlaneXY(0, 0, 0))  # -> Box, Box_2
deconstruct_brep_2 = DeconstructBrep(Brep=bounding_box.Box)  # -> Faces, Edges, Vertices
area = Area(Geometry=deconstruct_brep_2.Faces)  # -> Area, Centroid
deconstruct_2 = Deconstruct(Point=area.Centroid)  # -> XComponent, YComponent, ZComponent
sort_list = SortList(Keys=deconstruct_2.ZComponent, ValuesValuesA=deconstruct_brep_2.Faces)  # -> Keys, ValuesValuesA
list_item = ListItem(List=sort_list.ValuesValuesA, Index=0, Wrap=True)
project = Project(Curve=deconstruct_brep.Edges, Brep=list_item, Direction=Vector(0, 0, 1))  # -> simplify(Curve)
graft_tree = GraftTree(Tree=deconstruct_brep.Edges, IncludeEmptyLists=True, IncludeNullItems=True)  # -> simplify(Tree)
merge = Merge(Data1=project, Data2=graft_tree)
loft = Loft(Curves=merge, Options={Adjust=False, Closed=False, LoftEnds=0, LoftSimp=0, LoftType=0, Rebuild=10, Refit=0.01})
merge_2 = Merge(Data1=loft, Data2=scale_2.Geometry, Data3=list_item)  # -> flatten(Result)
# Bake Volume
brep_join = BrepJoin(Breps=merge_2)  # -> Breps, Closed

# ----
# Higher U V count results in
# higher resolution mesh
number_slider = Slider(300, range=5..1000)
# Refer to Meshing Surfaces in 'Mesh Geometry'
# Input surface
surface = Surface(merge_2)
# Draw line to describe vector
# 1) Bake final result
# 2) Save as STL file
# 3) You may simulate printing on CURA software
# Check Depth < 20 mm
line = Line(Line((11.70035342, -7.980818182, 17.06507602), (16.814074, 0, 9.683172913)))
mesh_surface = MeshSurface(Surface=surface, UCount=number_slider, VCount=number_slider, Overhang=True, Equalize=False)
# Colour mesh according to how the face aligns with a reference vector
deconstruct_mesh = DeconstructMesh(Mesh=mesh_surface)  # -> Vertices, Faces, Colours, Normals

# ---- group: Dot Product
unit_vector = UnitVector(Vector=line)
dot_product = DotProduct(VectorA=deconstruct_mesh.Normals, VectorB=unit_vector, Unitize=False)
absolute = Absolute(Value=dot_product)

# ----
bounds = Bounds(Numbers=absolute)
deconstruct_domain = DeconstructDomain(Domain=bounds)  # -> Start, End
# Change colour here
gradient = Gradient(
    LowerLimit=deconstruct_domain.Start,
    UpperLimit=deconstruct_domain.End,
    Parameter=absolute,
    stops=[0: RGB(90, 89, 84), 1: RGB(255, 255, 255), 1: RGB(234, 126, 0), 1: RGB(0, 255, 255), 1: RGB(244, 92, 103), 1: RGB(75, 107, 169), 1: RGB(173, 203, 249)])
construct_mesh = ConstructMesh(Vertices=deconstruct_mesh.Vertices, Faces=deconstruct_mesh.Faces, Colours=gradient)
brep_output = Brep(brep_join.Breps)
